# Dynamo graph Execute_extractTopology_Via_Id-algo-community.dyn "Execute_extractTopology_Via_Id" (Dynamo 2.12.0.5650)
# packages: Clockwork for Dynamo 2.x 2.3.0, bimorphNodes 4.1.2, archi-lab.net 2022.210.1022

model_name = StringInput("Bld type3_detached_Tanya")

# group: Get the directory
string = StringInput("")
run = BoolSelector(true)
file_repository = Python(IN[0]=run)  # CPython3
# ---------- file_repository.python (106 lines) ----------
###############################################################
# Import general packages.
import clr
import sys
import math
import System
import io
import os
import importlib

# Import Revit/Dynamo API related packages.
clr.AddReference('DynamoRevitDS')
import Dynamo
from System import Array
from System.Collections.Generic import *
clr.AddReference("RevitNodes")
import Revit
clr.ImportExtensions(Revit.Elements)
clr.ImportExtensions(Revit.GeometryConversion)
clr.AddReference("RevitServices")
import RevitServices
from RevitServices.Persistence import DocumentManager 
from RevitServices.Transactions import TransactionManager 
clr.AddReference("RevitAPI")
clr.AddReference('ProtoGeometry')
import Autodesk 
from Autodesk.DesignScript.Geometry import *
from Autodesk.DesignScript import *
from Autodesk.Revit.DB import *
from Autodesk.Revit.DB import Parameter
from Autodesk.Revit.DB.Architecture import *
from Autodesk.Revit.DB import IFailuresPreprocessor

# Import external python packages.
localapp = os.getenv(r'LOCALAPPDATA')
sys.path.append(os.path.join(localapp, r'python-3.8.3-embed-amd64\Lib\site-packages'))

# Import customized python packgaes.
sys.path.append(r'C:\dev\phd\jw\healing\src\godyn')

import healBasics
importlib.reload(healBasics)
import healChecks
importlib.reload(healChecks)
import healParameters
importlib.reload(healParameters)
import healVisual
importlib.reload(healVisual)

###############################################################
doc = DocumentManager.Instance.CurrentDBDocument


###############################################################
# Temporary functions

def getFileDirectory(filename=" ", subfolder = ""):
    """
    get the directory folder where the .rvt is stored.
    """

    dynscriptpath = Dynamo.Applications.DynamoRevit(
    ).RevitDynamoModel.CurrentWorkspace.FileName
    pathelement = dynscriptpath.split("\\")[:-1]
    folderpath = ""
    for i in pathelement:
        folderpath += (i + "\\")

    if filename != " ":
        if subfolder == "":
            folderpath += (filename)
        else:
            folderpath = folderpath + subfolder + "\\" + filename

    return folderpath

###############################################################
# Prepare the input (of the Python Node)
run = IN[0]


##############################################################
# Prepare the output (of the Python Node)
if run:
    out = getFileDirectory()
else:
    out = ''


###############################################################
# Start Transaction in Revit
TransactionManager.Instance.EnsureInTransaction(doc)


###############################################################
# Main part


###############################################################
# End Transaction in Revit
TransactionManager.Instance.TransactionTaskDone()


###############################################################
# End
OUT = out
# ----------------------------------------
string_2 = StringInput("data\")
string_3 = StringInput("\")
join = String.Join(separator=string, string0=file_repository, string1=string_2, string2=model_name, string3=string_3)
code_block = CodeBlock(directoryOUT=join) { directoryOUT; }

# group: object extraction (building elements and spaces)
string_4 = StringInput("collected_instances_space.json")
concat = String.Concat(string0=code_block, string1=string_4)
string_5 = StringInput("collected_instances_door.json")
concat_2 = String.Concat(string0=code_block, string1=string_5)
string_6 = StringInput("collected_instances_separationline.json")
concat_3 = String.Concat(string0=code_block, string1=string_6)
string_7 = StringInput("collected_instances_window.json")
concat_4 = String.Concat(string0=code_block, string1=string_7)
string_8 = StringInput("collected_instances_wall.json")
concat_5 = String.Concat(string0=code_block, string1=string_8)
string_9 = StringInput("collected_instances_slab.json")
concat_6 = String.Concat(string0=code_block, string1=string_9)

# group: Spaces
code_block_2 = CodeBlock { "Id"; }
code_block_3 = CodeBlock { "Perimeter"; "Area"; "Unbounded Height"; "Name"; "Level"; }
list_create = List.Create(item0=code_block_3.out0, item1=code_block_3.out1, item2=code_block_3.out2, item3=code_block_3.out3, item4=code_block_3.out4)
join_2 = List.Join(list0=code_block_2, list1=list_create)
categories = Categories("OST_Rooms")
all_elements_of_category = ElementsOfCategory(Category=categories)
id = Element.Id(element=all_elements_of_category)
string_from_object = FromObject(object=id)
getParameterValueByName = Element.GetParameterValueByName(element=all_elements_of_category@L1, parameterName=list_create)
addItemToFront = List.AddItemToFront(item=string_from_object@L1, list=getParameterValueByName@L2)
byKeysValues = DesignScript.Builtin.Dictionary.ByKeysValues(keys=join_2, values=addItemToFront@L2)
stringifyJSON = Data.StringifyJSON(values=byKeysValues)
writeText = FileSystem.WriteText(filePath=concat, text=stringifyJSON)

# group: Doors
code_block_4 = CodeBlock { "Id"; }
code_block_5 = CodeBlock { "Mark"; "Head Height"; }
list_create_2 = List.Create(item0=code_block_5.out0, item1=code_block_5.out1)
join_3 = List.Join(list0=code_block_4, list1=list_create_2)
categories_2 = Categories("OST_Doors")
all_elements_of_category_2 = ElementsOfCategory(Category=categories_2)
id_2 = Element.Id(element=all_elements_of_category_2)
string_from_object_2 = FromObject(object=id_2)
getParameterValueByName_2 = Element.GetParameterValueByName(element=all_elements_of_category_2@L1, parameterName=list_create_2)
addItemToFront_2 = List.AddItemToFront(item=string_from_object_2@L1, list=getParameterValueByName_2@L2)
byKeysValues_2 = DesignScript.Builtin.Dictionary.ByKeysValues(keys=join_3, values=addItemToFront_2@L2)
stringifyJSON_2 = Data.StringifyJSON(values=byKeysValues_2)
writeText_2 = FileSystem.WriteText(filePath=concat_2, text=stringifyJSON_2)

# group: Room Separation Lines
code_block_6 = CodeBlock { "Id"; }
run_roomseplines = BoolSelector(true)
get_roomseplines = Python(IN[0]=run_roomseplines)  # CPython3
# ---------- get_roomseplines.python (85 lines) ----------
###############################################################
# Import general packages.
import clr
import sys
import math
import System
import io
import os
import importlib

# Import Revit/Dynamo API related packages.
clr.AddReference('DynamoRevitDS')
import Dynamo
from System import Array
from System.Collections.Generic import *
clr.AddReference("RevitNodes")
import Revit
clr.ImportExtensions(Revit.Elements)
clr.ImportExtensions(Revit.GeometryConversion)
clr.AddReference("RevitServices")
import RevitServices
from RevitServices.Persistence import DocumentManager 
from RevitServices.Transactions import TransactionManager 
clr.AddReference("RevitAPI")
clr.AddReference('ProtoGeometry')
import Autodesk 
from Autodesk.DesignScript.Geometry import *
from Autodesk.DesignScript import *
from Autodesk.Revit.DB import *
from Autodesk.Revit.DB import Parameter
from Autodesk.Revit.DB.Architecture import *
from Autodesk.Revit.DB import IFailuresPreprocessor

# Import external python packages.
localapp = os.getenv(r'LOCALAPPDATA')
sys.path.append(os.path.join(localapp, r'python-3.8.3-embed-amd64\Lib\site-packages'))

# Import customized python packgaes.
sys.path.append(r'C:\dev\phd\jw\healing\src\godyn')

import healBasics
importlib.reload(healBasics)
import healChecks
importlib.reload(healChecks)
import healParameters
importlib.reload(healParameters)
import healVisual
importlib.reload(healVisual)

###############################################################
doc = DocumentManager.Instance.CurrentDBDocument


###############################################################
# Temporary functions


###############################################################
# Prepare the input (of the Python Node)
run = IN[0]


##############################################################
# Prepare the output (of the Python Node)
out = []


###############################################################
# Start Transaction in Revit
TransactionManager.Instance.EnsureInTransaction(doc)


###############################################################
# Main part
if run:
    out = FilteredElementCollector(doc).OfCategory(BuiltInCategory.OST_RoomSeparationLines).ToElements()

###############################################################
# End Transaction in Revit
TransactionManager.Instance.TransactionTaskDone()


###############################################################
# End
OUT = out
# ----------------------------------------
getParameterValueByName_3 = Element.GetParameterValueByName(element=get_roomseplines@L1, parameterName=code_block_6)
id_3 = Element.Id(element=get_roomseplines)
string_from_object_3 = FromObject(object=id_3)
addItemToEnd = List.AddItemToEnd(item=getParameterValueByName_3, list=string_from_object_3, lacing=Longest)
byKeysValues_3 = DesignScript.Builtin.Dictionary.ByKeysValues(keys=code_block_6, values=addItemToEnd@L2)
stringifyJSON_3 = Data.StringifyJSON(values=byKeysValues_3)
writeText_3 = FileSystem.WriteText(filePath=concat_3, text=stringifyJSON_3)

# group: space-element
string_10 = StringInput("collected_topology_space_host.txt")
code_block_7 = CodeBlock(topologySpaceHostTXT=string_10) { topologySpaceHostTXT; }
concat_7 = String.Concat(string0=code_block, string1=code_block_7)
string_11 = StringInput("collected_topology_space_walls.txt")
code_block_8 = CodeBlock(topologySpaceWallTXT=string_11) { topologySpaceWallTXT; }
concat_8 = String.Concat(string0=code_block, string1=code_block_8)
string_12 = StringInput("collected_topology_space_doors.txt")
code_block_9 = CodeBlock(topologySpaceDoorTXT=string_12) { topologySpaceDoorTXT; }
concat_9 = String.Concat(string0=code_block, string1=code_block_9)
string_13 = StringInput("collected_topology_space_windows.txt")
code_block_10 = CodeBlock(topologySpaceWindowTXT=string_13) { topologySpaceWindowTXT; }
concat_10 = String.Concat(string0=code_block, string1=code_block_10)
string_14 = StringInput("collected_topology_space_separationlines.txt")
code_block_11 = CodeBlock(topologySpaceSeplineTXT=string_14) { topologySpaceSeplineTXT; }
concat_11 = String.Concat(string0=code_block, string1=code_block_11)

# group: Get Real Room Boundaries (excluding those "Not placed" Rooms)
categories_3 = Categories("OST_Rooms")
all_elements_of_category_3 = ElementsOfCategory(Category=categories_3)
location = Room.Location(room=all_elements_of_category_3)
isNull = Object.IsNull(object=location)
filterByBoolMask = List.FilterByBoolMask(list=all_elements_of_category_3, mask=isNull)
boundaries = Custom[Room.Boundaries](room=filterByBoolMask.out)  # package Clockwork for Dynamo 2.x; Gets a list of all boundaries of a given room or area and a corresponding list of the elements that are generating those boundaries.
boolean = BoolSelector(false)
clean = List.Clean(list=boundaries.elements, preserveIndices=boolean)
type = Object.Type(object=clean@L2)

# group: Get spaces
code_block_12 = CodeBlock { "\n"; }
id_4 = Element.Id(element=filterByBoolMask.out)
string_from_object_4 = FromObject(object=id_4)
join_4 = String.Join(separator=code_block_12, string0=string_from_object_4)
writeText_4 = FileSystem.WriteText(filePath=concat_7, text=join_4)

# group: Get related walls
code_block_13 = CodeBlock { "\n"; }
code_block_14 = CodeBlock { ","; }
code_block_15 = CodeBlock { "Revit.Elements.Wall"; }
eq = type == code_block_15
filterByBoolMask_2 = List.FilterByBoolMask(list=clean, mask=eq)
id_5 = Element.Id(element=filterByBoolMask_2.in)
string_from_object_5 = FromObject(object=id_5)
join_5 = String.Join(separator=code_block_14, string0=string_from_object_5)
flatten = List.Flatten(list=join_5)
join_6 = String.Join(separator=code_block_13, string0=flatten)
writeText_5 = FileSystem.WriteText(filePath=concat_8, text=join_6)

# group: Get related doors
code_block_16 = CodeBlock { "\n"; }
code_block_17 = CodeBlock { ","; }
select_phase = RevitPhases()  # nothing selected
doors = Custom[Room.Doors](room=filterByBoolMask.out, phase=select_phase)  # package Clockwork for Dynamo 2.x; Retrieves all doors that are associated with a room (hosted in walls and roofs).
id_6 = Element.Id(element=doors)
string_from_object_6 = FromObject(object=id_6)
join_7 = String.Join(separator=code_block_17, string0=string_from_object_6)
flatten_2 = List.Flatten(list=join_7)
join_8 = String.Join(separator=code_block_16, string0=flatten_2)
writeText_6 = FileSystem.WriteText(filePath=concat_9, text=join_8)

# group: Get related windows
code_block_18 = CodeBlock { "\n"; }
code_block_19 = CodeBlock { ","; }
select_phase_2 = RevitPhases()  # nothing selected
windows = Custom[Room.Windows](room=filterByBoolMask.out, phase=select_phase_2)  # package Clockwork for Dynamo 2.x; Retrieves all windows that are associated with a room (hosted in walls and roofs).
id_7 = Element.Id(element=windows)
string_from_object_7 = FromObject(object=id_7)
join_9 = String.Join(separator=code_block_19, string0=string_from_object_7)
flatten_3 = List.Flatten(list=join_9)
join_10 = String.Join(separator=code_block_18, string0=flatten_3)
writeText_7 = FileSystem.WriteText(filePath=concat_10, text=join_10)

# group: Get related separation lines
code_block_20 = CodeBlock { "\n"; }
code_block_21 = CodeBlock { ","; }
code_block_22 = CodeBlock { "Revit.Elements.ModelCurve"; }
eq_2 = type == code_block_22
filterByBoolMask_3 = List.FilterByBoolMask(list=clean, mask=eq_2)
id_8 = Element.Id(element=filterByBoolMask_3.in)
string_from_object_8 = FromObject(object=id_8)
join_11 = String.Join(separator=code_block_21, string0=string_from_object_8)
join_12 = String.Join(separator=code_block_20, string0=join_11)
writeText_8 = FileSystem.WriteText(filePath=concat_11, text=join_12)

# group: Windows
code_block_23 = CodeBlock { "Id"; }
code_block_24 = CodeBlock { "Mark"; "Head Height"; }
list_create_3 = List.Create(item0=code_block_24.out0, item1=code_block_24.out1)
join_13 = List.Join(list0=code_block_23, list1=list_create_3)
categories_4 = Categories("OST_Windows")
all_elements_of_category_4 = ElementsOfCategory(Category=categories_4)
id_9 = Element.Id(element=all_elements_of_category_4)
string_from_object_9 = FromObject(object=id_9)
getParameterValueByName_4 = Element.GetParameterValueByName(element=all_elements_of_category_4@L1, parameterName=list_create_3)
addItemToFront_3 = List.AddItemToFront(item=string_from_object_9@L1, list=getParameterValueByName_4@L2)
byKeysValues_4 = DesignScript.Builtin.Dictionary.ByKeysValues(keys=join_13, values=addItemToFront_3@L2)
stringifyJSON_4 = Data.StringifyJSON(values=byKeysValues_4)
writeText_9 = FileSystem.WriteText(filePath=concat_4, text=stringifyJSON_4)

# group: Walls
code_block_25 = CodeBlock { "Id"; }
code_block_26 = CodeBlock { "Mark"; "Length"; "Unconnected Height"; "Level"; }
list_create_4 = List.Create(item0=code_block_26.out0, item1=code_block_26.out1, item2=code_block_26.out2, item3=code_block_26.out3)
join_14 = List.Join(list0=code_block_25, list1=list_create_4)
categories_5 = Categories("OST_Walls")
all_elements_of_category_5 = ElementsOfCategory(Category=categories_5)
id_10 = Element.Id(element=all_elements_of_category_5)
string_from_object_10 = FromObject(object=id_10)
getParameterValueByName_5 = Element.GetParameterValueByName(element=all_elements_of_category_5@L1, parameterName=list_create_4)
addItemToFront_4 = List.AddItemToFront(item=string_from_object_10@L1, list=getParameterValueByName_5@L2)
byKeysValues_5 = DesignScript.Builtin.Dictionary.ByKeysValues(keys=join_14, values=addItemToFront_4@L2)
stringifyJSON_5 = Data.StringifyJSON(values=byKeysValues_5)
writeText_10 = FileSystem.WriteText(filePath=concat_5, text=stringifyJSON_5)

# group: Slabs
code_block_27 = CodeBlock { "Id"; }
code_block_28 = CodeBlock { "Thickness"; }
list_create_5 = List.Create(item0=code_block_28)
join_15 = List.Join(list0=code_block_27, list1=list_create_5)
categories_6 = Categories("OST_Floors")
all_elements_of_category_6 = ElementsOfCategory(Category=categories_6)
id_11 = Element.Id(element=all_elements_of_category_6)
string_from_object_11 = FromObject(object=id_11)
getParameterValueByName_6 = Element.GetParameterValueByName(element=all_elements_of_category_6@L1, parameterName=list_create_5)
addItemToFront_5 = List.AddItemToFront(item=string_from_object_11@L1, list=getParameterValueByName_6@L2)
byKeysValues_6 = DesignScript.Builtin.Dictionary.ByKeysValues(keys=join_15, values=addItemToFront_5@L2)
stringifyJSON_6 = Data.StringifyJSON(values=byKeysValues_6)
writeText_11 = FileSystem.WriteText(filePath=concat_6, text=stringifyJSON_6)

# group: elememt-element
string_15 = StringInput("collected_topology_wall_host.txt")
concat_12 = String.Concat(string0=code_block, string1=string_15)
string_16 = StringInput("collected_topology_wall_inserts.txt")
concat_13 = String.Concat(string0=code_block, string1=string_16)
string_17 = StringInput("collected_topology_wall_walls.txt")
concat_14 = String.Concat(string0=code_block, string1=string_17)
string_18 = StringInput("collected_topology_wall_slabs.txt")
concat_15 = String.Concat(string0=code_block, string1=string_18)

# group: Wall as Core connections.
categories_7 = Categories("OST_Walls")
all_elements_of_category_7 = ElementsOfCategory(Category=categories_7)

# group: hosts (walls)
code_block_29 = CodeBlock { "\n"; }
id_12 = Element.Id(element=all_elements_of_category_7)
string_from_object_12 = FromObject(object=id_12)
join_16 = String.Join(separator=code_block_29, string0=string_from_object_12)
writeText_12 = FileSystem.WriteText(filePath=concat_12, text=join_16)
code_block_30 = CodeBlock { ","; }

# group: followers (doors and windows embedded in walls)
inserts = Custom[Element.Inserts](element=all_elements_of_category_7)  # package Clockwork for Dynamo 2.x; Gets all the objects inserted into a given element.
id_13 = Element.Id(element=inserts)
string_from_object_13 = FromObject(object=id_13)
join_17 = String.Join(separator=code_block_30, string0=string_from_object_13)
flatten_4 = List.Flatten(list=join_17)
join_18 = String.Join(separator=code_block_29, string0=flatten_4)
writeText_13 = FileSystem.WriteText(filePath=concat_13, text=join_18)

# group: connectors (walls - walls)
boundingBox = Element.BoundingBox(element=all_elements_of_category_7)
getElementsIntersect = Revit.BoundingBox.GetElementsIntersect(boundingBox=boundingBox, elements=all_elements_of_category_7)
id_14 = Element.Id(element=getElementsIntersect)
string_from_object_14 = FromObject(object=id_14)
join_19 = String.Join(separator=code_block_30, string0=string_from_object_14)
flatten_5 = List.Flatten(list=join_19)
join_20 = String.Join(separator=code_block_29, string0=flatten_5)
writeText_14 = FileSystem.WriteText(filePath=concat_14, text=join_20)

# group: floors (floors connected to walls)
boundingBox_2 = Element.BoundingBox(element=all_elements_of_category_7)
categories_8 = Categories("OST_Floors")
all_elements_of_category_8 = ElementsOfCategory(Category=categories_8)
type_2 = archilab.Revit.Elements.Elements.Type(element=all_elements_of_category_8)
name = Element.Name(element=type_2)
string_19 = StringInput("Topping")
contains = String.Contains(string=name, searchFor=string_19)
filterByBoolMask_4 = List.FilterByBoolMask(list=all_elements_of_category_8, mask=contains)
getElementsIntersect_2 = Revit.BoundingBox.GetElementsIntersect(boundingBox=boundingBox_2, elements=filterByBoolMask_4.out)
id_15 = Element.Id(element=getElementsIntersect_2)
string_from_object_15 = FromObject(object=id_15)
join_21 = String.Join(separator=code_block_30, string0=string_from_object_15)
flatten_6 = List.Flatten(list=join_21)
join_22 = String.Join(separator=code_block_29, string0=flatten_6)
writeText_15 = FileSystem.WriteText(filePath=concat_15, text=join_22)

geometry = Element.Geometry(element=all_elements_of_category_5)  # frozen
boundingBox_3 = Geometry.BoundingBox(geometry=geometry)
minPoint = BoundingBox.MinPoint(boundingBox=boundingBox_3)
maxPoint = BoundingBox.MaxPoint(boundingBox=boundingBox_3)
