# Dynamo graph Execute_extractTopology_Via_Id-gnn.dyn (Dynamo 2.12.0.5650)
# packages: archi-lab.net 2022.210.1022

model_name = StringInput("Bld type3_detached_gnn")

# group: Get the directory
string = StringInput("")
run = BoolSelector(true)
file_repository = Python(IN[0]=run)  # CPython3
# ---------- file_repository.python (106 lines) ----------
###############################################################
# Import general packages.
import clr
import sys
import math
import System
import io
import os
import importlib

# Import Revit/Dynamo API related packages.
clr.AddReference('DynamoRevitDS')
import Dynamo
from System import Array
from System.Collections.Generic import *
clr.AddReference("RevitNodes")
import Revit
clr.ImportExtensions(Revit.Elements)
clr.ImportExtensions(Revit.GeometryConversion)
clr.AddReference("RevitServices")
import RevitServices
from RevitServices.Persistence import DocumentManager 
from RevitServices.Transactions import TransactionManager 
clr.AddReference("RevitAPI")
clr.AddReference('ProtoGeometry')
import Autodesk 
from Autodesk.DesignScript.Geometry import *
from Autodesk.DesignScript import *
from Autodesk.Revit.DB import *
from Autodesk.Revit.DB import Parameter
from Autodesk.Revit.DB.Architecture import *
from Autodesk.Revit.DB import IFailuresPreprocessor

# Import external python packages.
localapp = os.getenv(r'LOCALAPPDATA')
sys.path.append(os.path.join(localapp, r'python-3.8.3-embed-amd64\Lib\site-packages'))

# Import customized python packgaes.
sys.path.append(r'C:\dev\phd\jw\healing\src\godyn')

import healBasics
importlib.reload(healBasics)
import healChecks
importlib.reload(healChecks)
import healParameters
importlib.reload(healParameters)
import healVisual
importlib.reload(healVisual)

###############################################################
doc = DocumentManager.Instance.CurrentDBDocument


###############################################################
# Temporary functions

def getFileDirectory(filename=" ", subfolder = ""):
    """
    get the directory folder where the .rvt is stored.
    """

    dynscriptpath = Dynamo.Applications.DynamoRevit(
    ).RevitDynamoModel.CurrentWorkspace.FileName
    pathelement = dynscriptpath.split("\\")[:-1]
    folderpath = ""
    for i in pathelement:
        folderpath += (i + "\\")

    if filename != " ":
        if subfolder == "":
            folderpath += (filename)
        else:
            folderpath = folderpath + subfolder + "\\" + filename

    return folderpath

###############################################################
# Prepare the input (of the Python Node)
run = IN[0]


##############################################################
# Prepare the output (of the Python Node)
if run:
    out = getFileDirectory()
else:
    out = ''


###############################################################
# Start Transaction in Revit
TransactionManager.Instance.EnsureInTransaction(doc)


###############################################################
# Main part


###############################################################
# End Transaction in Revit
TransactionManager.Instance.TransactionTaskDone()


###############################################################
# End
OUT = out
# ----------------------------------------
string_2 = StringInput("data\")
string_3 = StringInput("\")
join = String.Join(separator=string, string0=file_repository, string1=string_2, string2=model_name, string3=string_3)
code_block = CodeBlock(directoryOUT=join) { directoryOUT; }

string_4 = StringInput("feature_window.csv")
concat = String.Concat(string0=code_block, string1=string_4)
space = CodeBlock { "id"; "xmax"; "ymax"; "zmax"; "xmin"; "ymin"; "zmin"; "length"; "height"; "width"; }
list_create = List.Create(item0=space.out0, item1=space.out1, item2=space.out2, item3=space.out3, item4=space.out4, item5=space.out5, item6=space.out6, item7=space.out7, item8=space.out8, item9=space.out9)
categories = Categories("OST_Windows")  # frozen
space_2 = CodeBlock { "Length"; "Height"; "Width"; }
list_create_2 = List.Create(item0=space_2.out0, item1=space_2.out1, item2=space_2.out2)

# group: xyzmin, xyzmax
all_elements_of_category = ElementsOfCategory(Category=categories)
id = Element.Id(element=all_elements_of_category)
string_from_object = FromObject(object=id)
boundingBox = Element.BoundingBox(element=all_elements_of_category)
maxPoint = BoundingBox.MaxPoint(boundingBox=boundingBox)
X = Point.X(point=maxPoint@L1)
Y = Point.Y(point=maxPoint@L1)
Z = Point.Z(point=maxPoint@L1)
list_create_3 = List.Create(item0=X, item1=Y, item2=Z)
minPoint = BoundingBox.MinPoint(boundingBox=boundingBox)
X_2 = Point.X(point=minPoint@L1)
Y_2 = Point.Y(point=minPoint@L1)
Z_2 = Point.Z(point=minPoint@L1)
list_create_4 = List.Create(item0=X_2, item1=Y_2, item2=Z_2)
type = archilab.Revit.Elements.Elements.Type(element=all_elements_of_category)
getParameterValueByName = Element.GetParameterValueByName(element=type@L1, parameterName=list_create_2)
transpose = List.Transpose(lists=getParameterValueByName)
join_2 = List.Join(list0=list_create_3, list1=list_create_4, list2=transpose)
addItemToFront = List.AddItemToFront(item=string_from_object, list=join_2)

transpose_2 = List.Transpose(lists=addItemToFront)
addItemToFront_2 = List.AddItemToFront(item=list_create, list=transpose_2)
exportCSV = Data.ExportCSV(filePath=concat, data=addItemToFront_2)
string_5 = StringInput("feature_wall.csv")
concat_2 = String.Concat(string0=code_block, string1=string_5)
categories_2 = Categories("OST_Walls")
space_3 = CodeBlock { "Length"; "Unconnected Height"; }  # frozen
list_create_5 = List.Create(item0=space_3.out0, item1=space_3.out1)
space_4 = CodeBlock { "Width"; }
list_create_6 = List.Create(item0=space_4)

# group: xyzmin, xyzmax
all_elements_of_category_2 = ElementsOfCategory(Category=categories_2)
id_2 = Element.Id(element=all_elements_of_category_2)
string_from_object_2 = FromObject(object=id_2)
boundingBox_2 = Element.BoundingBox(element=all_elements_of_category_2)
maxPoint_2 = BoundingBox.MaxPoint(boundingBox=boundingBox_2)
X_3 = Point.X(point=maxPoint_2@L1)
Y_3 = Point.Y(point=maxPoint_2@L1)
Z_3 = Point.Z(point=maxPoint_2@L1)
list_create_7 = List.Create(item0=X_3, item1=Y_3, item2=Z_3)
minPoint_2 = BoundingBox.MinPoint(boundingBox=boundingBox_2)
X_4 = Point.X(point=minPoint_2@L1)
Y_4 = Point.Y(point=minPoint_2@L1)
Z_4 = Point.Z(point=minPoint_2@L1)
list_create_8 = List.Create(item0=X_4, item1=Y_4, item2=Z_4)
getParameterValueByName_2 = Element.GetParameterValueByName(element=all_elements_of_category_2@L1, parameterName=list_create_5)
transpose_3 = List.Transpose(lists=getParameterValueByName_2)
type_2 = archilab.Revit.Elements.Elements.Type(element=all_elements_of_category_2)
getParameterValueByName_3 = Element.GetParameterValueByName(element=type_2@L1, parameterName=list_create_6)
transpose_4 = List.Transpose(lists=getParameterValueByName_3)
join_3 = List.Join(list0=list_create_7, list1=list_create_8, list2=transpose_3, list3=transpose_4)
addItemToFront_3 = List.AddItemToFront(item=string_from_object_2, list=join_3)

transpose_5 = List.Transpose(lists=addItemToFront_3)
addItemToFront_4 = List.AddItemToFront(item=list_create, list=transpose_5)
exportCSV_2 = Data.ExportCSV(filePath=concat_2, data=addItemToFront_4)
string_6 = StringInput("feature_door.csv")
concat_3 = String.Concat(string0=code_block, string1=string_6)
categories_3 = Categories("OST_Doors")  # frozen
space_5 = CodeBlock { "Length"; "Height"; "Width"; }
list_create_9 = List.Create(item0=space_5.out0, item1=space_5.out1, item2=space_5.out2)

# group: xyzmin, xyzmax
all_elements_of_category_3 = ElementsOfCategory(Category=categories_3)
id_3 = Element.Id(element=all_elements_of_category_3)
string_from_object_3 = FromObject(object=id_3)
boundingBox_3 = Element.BoundingBox(element=all_elements_of_category_3)
maxPoint_3 = BoundingBox.MaxPoint(boundingBox=boundingBox_3)
X_5 = Point.X(point=maxPoint_3@L1)
Y_5 = Point.Y(point=maxPoint_3@L1)
Z_5 = Point.Z(point=maxPoint_3@L1)
list_create_10 = List.Create(item0=X_5, item1=Y_5, item2=Z_5)
minPoint_3 = BoundingBox.MinPoint(boundingBox=boundingBox_3)
X_6 = Point.X(point=minPoint_3@L1)
Y_6 = Point.Y(point=minPoint_3@L1)
Z_6 = Point.Z(point=minPoint_3@L1)
list_create_11 = List.Create(item0=X_6, item1=Y_6, item2=Z_6)
type_3 = archilab.Revit.Elements.Elements.Type(element=all_elements_of_category_3)
getParameterValueByName_4 = Element.GetParameterValueByName(element=type_3@L1, parameterName=list_create_9)
transpose_6 = List.Transpose(lists=getParameterValueByName_4)
join_4 = List.Join(list0=list_create_10, list1=list_create_11, list2=transpose_6)
addItemToFront_5 = List.AddItemToFront(item=string_from_object_3, list=join_4)

transpose_7 = List.Transpose(lists=addItemToFront_5)
addItemToFront_6 = List.AddItemToFront(item=list_create, list=transpose_7)
exportCSV_3 = Data.ExportCSV(filePath=concat_3, data=addItemToFront_6)
string_7 = StringInput("feature_space_sr.csv")
concat_4 = String.Concat(string0=code_block, string1=string_7)

# group: SPACE
categories_4 = Categories("OST_Rooms")
all_elements_of_category_4 = ElementsOfCategory(Category=categories_4)
code_block_2 = CodeBlock { "Name"; }
getParameterValueByName_5 = Element.GetParameterValueByName(element=all_elements_of_category_4@L1, parameterName=code_block_2)
code_block_3 = CodeBlock { "SR"; }
eq = getParameterValueByName_5 == code_block_3
filterByBoolMask = List.FilterByBoolMask(list=all_elements_of_category_4, mask=eq)  # frozen

code_block_4 = CodeBlock(SR_space=filterByBoolMask.in) { SR_space; }

# group: xyzmin, xyzmax
id_4 = Element.Id(element=code_block_4)
string_from_object_4 = FromObject(object=id_4)
boundingBox_4 = Element.BoundingBox(element=code_block_4)
maxPoint_4 = BoundingBox.MaxPoint(boundingBox=boundingBox_4)
X_7 = Point.X(point=maxPoint_4@L1)
Y_7 = Point.Y(point=maxPoint_4@L1)
Z_7 = Point.Z(point=maxPoint_4@L1)
list_create_12 = List.Create(item0=X_7, item1=Y_7, item2=Z_7)
minPoint_4 = BoundingBox.MinPoint(boundingBox=boundingBox_4)
X_8 = Point.X(point=minPoint_4@L1)
Y_8 = Point.Y(point=minPoint_4@L1)
Z_8 = Point.Z(point=minPoint_4@L1)
list_create_13 = List.Create(item0=X_8, item1=Y_8, item2=Z_8)
join_5 = List.Join(list0=list_create_12, list1=list_create_13)
addItemToFront_7 = List.AddItemToFront(item=string_from_object_4, list=join_5)

transpose_8 = List.Transpose(lists=addItemToFront_7)
addItemToFront_8 = List.AddItemToFront(item=list_create, list=transpose_8)
exportCSV_4 = Data.ExportCSV(filePath=concat_4, data=addItemToFront_8)
string_8 = StringInput("feature_space_non_sr.csv")
concat_5 = String.Concat(string0=code_block, string1=string_8)
code_block_5 = CodeBlock(no_SR_space=filterByBoolMask.out) { no_SR_space; }  # frozen

# group: xyzmin, xyzmax
id_5 = Element.Id(element=code_block_5)
string_from_object_5 = FromObject(object=id_5)
boundingBox_5 = Element.BoundingBox(element=code_block_5)
maxPoint_5 = BoundingBox.MaxPoint(boundingBox=boundingBox_5)
X_9 = Point.X(point=maxPoint_5@L1)
Y_9 = Point.Y(point=maxPoint_5@L1)
Z_9 = Point.Z(point=maxPoint_5@L1)
list_create_14 = List.Create(item0=X_9, item1=Y_9, item2=Z_9)
minPoint_5 = BoundingBox.MinPoint(boundingBox=boundingBox_5)
X_10 = Point.X(point=minPoint_5@L1)
Y_10 = Point.Y(point=minPoint_5@L1)
Z_10 = Point.Z(point=minPoint_5@L1)
list_create_15 = List.Create(item0=X_10, item1=Y_10, item2=Z_10)
join_6 = List.Join(list0=list_create_14, list1=list_create_15)
addItemToFront_9 = List.AddItemToFront(item=string_from_object_5, list=join_6)

transpose_9 = List.Transpose(lists=addItemToFront_9)
addItemToFront_10 = List.AddItemToFront(item=list_create, list=transpose_9)
exportCSV_5 = Data.ExportCSV(filePath=concat_5, data=addItemToFront_10)
string_9 = StringInput("feature_space.csv")
concat_6 = String.Concat(string0=code_block, string1=string_9)

# group: xyzmin, xyzmax
id_6 = Element.Id(element=all_elements_of_category_4)
string_from_object_6 = FromObject(object=id_6)
boundingBox_6 = Element.BoundingBox(element=all_elements_of_category_4)
maxPoint_6 = BoundingBox.MaxPoint(boundingBox=boundingBox_6)
X_11 = Point.X(point=maxPoint_6@L1)
Y_11 = Point.Y(point=maxPoint_6@L1)
Z_11 = Point.Z(point=maxPoint_6@L1)
list_create_16 = List.Create(item0=X_11, item1=Y_11, item2=Z_11)
minPoint_6 = BoundingBox.MinPoint(boundingBox=boundingBox_6)
X_12 = Point.X(point=minPoint_6@L1)
Y_12 = Point.Y(point=minPoint_6@L1)
Z_12 = Point.Z(point=minPoint_6@L1)
list_create_17 = List.Create(item0=X_12, item1=Y_12, item2=Z_12)
join_7 = List.Join(list0=list_create_16, list1=list_create_17)
addItemToFront_11 = List.AddItemToFront(item=string_from_object_6, list=join_7)

transpose_10 = List.Transpose(lists=addItemToFront_11)
addItemToFront_12 = List.AddItemToFront(item=list_create, list=transpose_10)
exportCSV_6 = Data.ExportCSV(filePath=concat_6, data=addItemToFront_12)
